# Grasshopper definition edgedraw.gh (Grasshopper 1.0.7)
# plug-ins: ghgl

colour = ColourPicker(PickedColour=RGB(77, 255, 124))
colour_2 = ColourPicker(PickedColour=RGB(40, 89, 53))
brep = Brep([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])
col = Colour(RGB(223, 42, 255))
c_script = CSharpScript(breps=brep)  # -> pos0, pos1, fn0, fn1; inputs breps: list of Brep
# ---------- c_script: C# ----------
    var _pos0 = new List<Point3d>();
    var _pos1 = new List<Point3d>();
    var _fn0 = new List<Vector3d>();
    var _fn1 = new List<Vector3d>();

    foreach( var brep in breps)
    {
      var meshes = Mesh.CreateFromBrep(brep, MeshingParameters.QualityRenderMesh);
      foreach(var mesh in meshes)
      {
        mesh.FaceNormals.ComputeFaceNormals();

        for( int i = 0; i < mesh.TopologyEdges.Count; i++ )
        {
          var pair = mesh.TopologyEdges.GetTopologyVertices(i);
          _pos0.Add(mesh.TopologyVertices[pair.I]);
          _pos1.Add(mesh.TopologyVertices[pair.J]);
          var faceIndices = mesh.TopologyEdges.GetConnectedFaces(i);
          _fn0.Add(mesh.FaceNormals[faceIndices[0]]);
          if( faceIndices.Length > 1 )
            _fn1.Add(mesh.FaceNormals[faceIndices[1]]);
          else
            _fn1.Add(new Vector3d());
        }
      }
    }
    pos0 = _pos0;
    pos1 = _pos1;
    fn0 = _fn0;
    fn1 = _fn1;
# ---------- end c_script ----------
gl_shader = GLShader(
    Pos0=c_script.pos0,
    Pos1=c_script.pos1,
    Fn0=c_script.fn0,
    Fn1=c_script.fn1,
    Silcolor=colour,
    CreaseColor=colour_2,
    Bordercolor=col,
    DepthTestingEnabled=False,
    DepthWritingEnabled=True,
    DrawMode=0,
    FragmentShader="""#version 330

in vec4 gs_color;

void main()
{
  gl_FragColor = gs_color;
}""",
    GLShader=(0, 1, 0),
    GeometryShader="""#version 330 core
layout (std140) uniform;

layout(points) in;
layout(line_strip, max_vertices = 2) out;

uniform vec4 silcolor;
uniform vec4 creasecolor;
uniform vec4 bordercolor;

uniform mat4 _worldToClip;
uniform vec3 _cameraLocation;

in vec3 vs_position0[];
in vec3 vs_position1[];
in vec3 vs_normal0[];
in vec3 vs_normal1[];

out vec4 gs_color;

bool IsSilhouette(in vec3 position1, in vec3 position2){
  vec3 midpoint = (position1+position2) * 0.5;
  vec3 midToCam = normalize(_cameraLocation - midpoint);
  float d0 = dot(midToCam, vs_normal0[0]);
  float d1 = dot(midToCam, vs_normal1[0]);
  bool is_silhouette = (d0 * d1) < 0;
  return is_silhouette;
}

bool IsCrease(in vec3 normal1, in vec3 normal2) {
  float angle = acos( min( 1.0f, max( -1.0f, (normal1.x * normal2.x) + 
                                        (normal1.y * normal2.y) +
                                        (normal1.z * normal2.z) ) ) );
  const float minAngle = 3.14159265 / 6.0f;
  bool is_crease = abs(angle) > minAngle;
  return is_crease;
}

void main() {
  bool is_silhouette = IsSilhouette(vs_position0[0], vs_position1[0]);
  bool is_border = vs_normal1[0].x==0.0 && vs_normal1[0].y==0.0 && vs_normal1[0].z==0.0;
  bool is_crease = IsCrease(vs_normal0[0], vs_normal1[0]);

  if( is_silhouette )
    gs_color = silcolor;
  if( is_border )
    gs_color = bordercolor;
  if( is_crease )
    gs_color = creasecolor;

  if( is_silhouette || is_border || is_crease ) {
    vec4 po0 = _worldToClip*vec4(vs_position0[0],1);
    vec4 po1 = _worldToClip*vec4(vs_position1[0],1);
    gl_Position = po0;
    EmitVertex();
    gl_Position = po1;
    EmitVertex();
  }
  EndPrimitive();
}""",
    PreviewSortOrder=5,
    VertexShader="""#version 330

layout(location = 0) in vec3 pos0;
layout(location = 1) in vec3 pos1;
layout(location = 2) in vec3 fn0;
layout(location = 3) in vec3 fn1;

uniform mat4 _worldToClip;

out vec3 vs_position0;
out vec3 vs_position1;
out vec3 vs_normal0;
out vec3 vs_normal1;

void main() 
{
  vs_position0 = pos0;
  vs_position1 = pos1;
  vs_normal0 = fn0;
  vs_normal1 = fn1;
}""",
    glLineWidth=4,
    glPointSize=8)
