# Grasshopper definition glslify-ShadingEffects.gh (Grasshopper 1.0.7)
# plug-ins: ghgl

brep = Brep([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])
mesh = Mesh(brep)
mcol = MeshColours(
    Mesh=mesh,
    Colours=[RGB(127, 255, 0), RGB(0, 100, 0), RGB(34, 139, 34), RGB(124, 252, 0), RGB(154, 205, 50), RGB(173, 255, 47), RGB(50, 205, 50), RGB(152, 251, 152)])
txt = Text("fieldstone-n.jpg")
gl_mesh = GLMeshShader(
    M=mcol,
    NormalMap=txt,
    DepthTestingEnabled=True,
    DepthWritingEnabled=True,
    DrawMode=4,
    FragmentShader="""#version 330

#pragma glslify: beckmann = require(glsl-specular-beckmann) 
#pragma glslify: gaussSpec = require(glsl-specular-gaussian) 
#pragma glslify: phongSpec = require(glsl-specular-phong) 
#pragma glslify: blinnPhongSpec = require(glsl-specular-blinn-phong) 
#pragma glslify: lambert = require(glsl-diffuse-lambert) 
#pragma glslify: perturb = require('glsl-perturb-normal') 
#line 10

uniform sampler2D normalMap;
uniform vec3 _cameraLocation;
uniform vec3  lightPosition = vec3(0.0, -10.0, 10.0);
uniform float roughness = 28.0;
 
in vec3 surfacePosition;
in vec3 Normal;
in vec4 vertexColor;
in vec2 vUV;

out vec4 FragColor;

void main() 
{
  vec3 eyeDirection = normalize(_cameraLocation - surfacePosition);
  vec3 lightDirection = normalize(lightPosition - surfacePosition);
  vec3 normal = normalize(Normal);

  vec2 uv = vUV * 4.0;
  vec3 normalRGB = texture(normalMap, uv, 0).rgb;
 
  //expand into -1.0 .. 1.0 range 
  vec3 normalMap = normalRGB * 2.0 - 1.0;
 
  normal = perturb(normalMap, normal, normalize(surfacePosition), uv);

  float spec = phongSpec(lightDirection, eyeDirection, normal, roughness);
  float diff = lambert(lightDirection, normal);

  vec3 diffColor = vec3(0.8, 0.0, 0.0);
  vec3 specColor = vec3(1.0, 1.0, 1.0);
  FragColor = vec4(diffColor*diff + specColor*spec, 1.0);
}""",
    GLShader=(0, 1, 0),
    VertexShader="""#version 330

layout(location = 0) in vec3 _meshVertex;
layout(location = 1) in vec3 _meshNormal;
layout(location = 2) in vec4 _meshVertexColor;
layout(location = 3) in vec2 _meshTextureCoordinate;

uniform mat4 _worldToClip;
out vec3 Normal;
out vec4 vertexColor;
out vec2 vUV;
out vec3 surfacePosition;

void main() 
{
  Normal = _meshNormal;
  vUV = _meshTextureCoordinate;
  vertexColor = _meshVertexColor;
  surfacePosition = _meshVertex;
  gl_Position = _worldToClip * vec4(_meshVertex,1);
}""",
    glLineWidth=3,
    glPointSize=8)
