# Grasshopper definition image_mix.gh (Grasshopper 1.0.4)
# plug-ins: ghgl

pt = Point(Point(-3, 3, 0))
path = FilePath("C:\dev\github\mcneel\ghgl\tests\quito_graffiti.jpg")
path_2 = FilePath("C:\dev\github\mcneel\ghgl\tests\iguana.jpg")
gl_shader = GLShader(
    world_vertex=pt,
    radius=Slider(19, range=1..1050),
    graffiti=path,
    iguana=path_2,
    amount=Slider(34.2, range=0..100),
    DrawMode=0,
    FragmentShader="""#version 330 core

uniform vec2 _viewportSize;
uniform sampler2D graffiti;
uniform sampler2D iguana;
uniform float amount;
in vec2 texture_coordinate;

out vec4 fragment_color;
void main() 
{
  vec4 c0 = texture(graffiti, texture_coordinate);
  vec4 c1 = texture(iguana, texture_coordinate);
  float t = amount / 100.0;
  fragment_color = mix(c0,c1,t);
}""",
    GeometryShader="""#version 330 core

layout(points) in;
layout(triangle_strip, max_vertices = 4) out;

uniform float radius;
uniform mat4 _worldToClip;

out vec2 texture_coordinate;

void main()
{
  vec4 center =  gl_in[0].gl_Position;

  texture_coordinate = vec2(0.0,1.0);
  gl_Position = _worldToClip * vec4(center.x-radius, center.y-radius, center.z, 1);
  EmitVertex();

  texture_coordinate = vec2(1.0,1.0);
  gl_Position = _worldToClip * vec4(center.x+radius, center.y-radius, center.z, 1);
  EmitVertex();

  texture_coordinate = vec2(0.0,0.0);
  gl_Position = _worldToClip * vec4(center.x-radius, center.y+radius, center.z, 1);
  EmitVertex();

  texture_coordinate = vec2(1.0,0.0);
  gl_Position = _worldToClip * vec4(center.x+radius, center.y+radius, center.z, 1);
  EmitVertex();

  EndPrimitive();
}""",
    glLineWidth=3,
    glPointSize=8,
    GLShader=(0, 1, 0),
    VertexShader="""#version 330

layout(location = 0) in vec3 world_vertex;

void main() {
  gl_Position = vec4(world_vertex,1);
}""")
