# Grasshopper definition pixelate.gh (Grasshopper 1.0.7)
# plug-ins: ghgl

rec = Rectangle({Plane=PlaneXY(2.242149349, 3.98823412, 0), Size=Domain2(u=-53.20773563..53.20773563, v=-51.57057454..51.57057454)})
pt = Point(Point(-3, 3, 0))
txt = Text("quito_graffiti.jpg")
gl_shader = GLShader(
    World_vertex=pt,
    Radius=Slider(41, range=1..200),
    Image=txt,
    Amount=Slider(9.62, range=0..50),
    DepthTestingEnabled=True,
    DepthWritingEnabled=True,
    DrawMode=0,
    FragmentShader="""#version 330 core

uniform vec2 _viewportSize;
uniform sampler2D image;
uniform float amount;

in vec2 texture_coordinate;
out vec4 fragColor;

void main() {
  vec4 color;
  if (amount > 0.01) {
    float x = texture_coordinate.s * _viewportSize.x;
    x = x - mod(x, amount) + amount * 0.5;
    x = x / _viewportSize.x;
    float y = texture_coordinate.t * _viewportSize.y;
    y = y - mod(y, amount) + amount * 0.5;
    y = y / _viewportSize.y;
    vec2 p = vec2(x, y);
    color = texture(image, p);
  } else {
    color = texture(image, texture_coordinate);
  }
  fragColor = color;
}""",
    GLShader=(0, 1, 0),
    GeometryShader="""#version 330 core

layout(points) in;
layout(triangle_strip, max_vertices = 4) out;

uniform float radius;
uniform mat4 _worldToClip;

out vec2 texture_coordinate;

void main()
{
  vec4 center =  gl_in[0].gl_Position;

  texture_coordinate = vec2(0.0,1.0);
  gl_Position = _worldToClip * vec4(center.x-radius, center.y-radius, center.z, 1);
  EmitVertex();

  texture_coordinate = vec2(1.0,1.0);
  gl_Position = _worldToClip * vec4(center.x+radius, center.y-radius, center.z, 1);
  EmitVertex();

  texture_coordinate = vec2(0.0,0.0);
  gl_Position = _worldToClip * vec4(center.x-radius, center.y+radius, center.z, 1);
  EmitVertex();

  texture_coordinate = vec2(1.0,0.0);
  gl_Position = _worldToClip * vec4(center.x+radius, center.y+radius, center.z, 1);
  EmitVertex();

  EndPrimitive();
}""",
    PreviewSortOrder=5,
    VertexShader="""#version 330

layout(location = 0) in vec3 world_vertex;

void main() {
  gl_Position = vec4(world_vertex, 1.0);
}""",
    glLineWidth=3,
    glPointSize=8)
