# Grasshopper definition two_sided_material.gh (Grasshopper 1.0.4)
# plug-ins: ghgl

brep = Brep([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])
bbox = BoundingBox(Content=brep, Plane=PlaneXY(0, 0, 0), UnionBox=True)  # -> Box, Box_2
debox = DeconstructBox(Box=bbox.Box)  # -> Plane, X, Y, Z
dedomain = DeconstructDomain(Domain=debox.X)  # -> Start, End
col = Colour(RGB(112, 90, 255))
col_2 = Colour(RGB(234, 45, 255))
gl_mesh = GLMeshShader(
    M=brep,
    xStart=dedomain.Start,
    discardGap=Slider(0.4, range=0..0.9),
    frontDiffuse=col,
    backDiffuse=col_2,
    DrawMode=4,
    FragmentShader="""#version 330

uniform int _lightCount;
uniform vec3 _lightDirection[4];
uniform mat3 _worldToCameraNormal;
uniform float _time;
uniform vec4 frontDiffuse;
uniform vec4 backDiffuse;
uniform float xStart;
uniform float discardGap;

in vec3 normal;
in vec2 textureCoordinate;
in float x;

void main()
{
  float d = x - xStart + _time;
  if(abs(d-int(d))<discardGap)
    discard;
  vec3 l = normalize(_lightDirection[0]);
  vec3 camNormal = _worldToCameraNormal * normal;
  float intensity = dot(l,normalize(camNormal.xyz));
  vec4 diffuse = backDiffuse;
  if(intensity<0) {
    diffuse = frontDiffuse;
    intensity = -intensity;
  }

  vec3 ambient = vec3(0.1,0.1,0.1) * diffuse.rgb;
  vec3 c = ambient + diffuse.rgb * intensity;
  gl_FragColor = vec4(c, diffuse.a);
}""",
    glLineWidth=3,
    glPointSize=8,
    GLShader=(0, 1, 0),
    VertexShader="""#version 330

layout(location = 0) in vec3 _meshVertex;
layout(location = 1) in vec3 _meshNormal;
layout(location = 2) in vec2 _meshTextureCoordinate;

uniform mat4 _worldToClip;
out vec3 normal;
out vec2 textureCoordinate;
out float x;

void main() 
{
  normal = normalize(_meshNormal);
  textureCoordinate = _meshTextureCoordinate;
  x = _meshVertex.x;
  gl_Position = _worldToClip * vec4(_meshVertex,1);
}""")
